# Dynamo graph 0 ReArtsy Добавить общие параметры.dyn "0.0_ReArtsy_Add_SharedParameters" (Dynamo 2.0.3.8810)

transpose = List.Transpose()  # frozen; unwired: lists
code_block = CodeBlock { 0; }
getItemAtIndex = List.GetItemAtIndex(list=transpose@L2, index=code_block)
sortByKey = List.SortByKey(list=transpose, keys=getItemAtIndex)
transpose_2 = List.Transpose(lists=sortByKey.sorted_list)
file_path = Filename(".\Artrsy_Params_List.txt")  # graph input
importCSV = Data.ImportCSV(filePath=file_path)
code_block_2 = CodeBlock(list=importCSV) { list[0]; }
sharedParameterFile = Parameter.SharedParameterFile()
parse = Custom[SharedParameterFile.Parse](path=sharedParameterFile)  # Returns all parameters from a shared parameter file.
code_block_3 = CodeBlock()
# ---------- code_block_3.designscript (5 lines) ----------
{"TEXT":"Text",
"MULTILINETEXT":"MultilineText",
"INTEGER":"Integer",
"NUMBER":"Number",
"URL":"URL"};
# ----------------------------------------
code_block_4 = CodeBlock(ngroup=parse.groups, dtdic=code_block_3, type=parse.data_types) { [ngroup, dtdic[type]]; }
transpose_3 = List.Transpose(lists=code_block_4)
byKeysValues = DesignScript.Builtin.Dictionary.ByKeysValues(keys=parse.names, values=transpose_3)
valueAtKey = DesignScript.Builtin.Dictionary.ValueAtKey(dictionary=byKeysValues, key=code_block_2)
code_block_5 = CodeBlock { 0; }
getItemAtIndex_2 = List.GetItemAtIndex(list=valueAtKey@L2, index=code_block_5)
code_block_6 = CodeBlock { 1; }
getItemAtIndex_3 = List.GetItemAtIndex(list=valueAtKey@L2, index=code_block_6)
select_builtin_parameter_group = BuiltInParameterGroup(index=26)
boolean = BoolSelector(true)
categories = Categories(index=372)
addSharedParameter = Orchid.RevitProject.Parameters.Parameter.AddSharedParameter(parameterName=code_block_2, groupName=getItemAtIndex_2, type=getItemAtIndex_3, group=select_builtin_parameter_group, instance=boolean, category=categories)
watch = Watch(addSharedParameter)  # graph output
code_block_7 = CodeBlock(w=parse.names) { w; }
