# Dynamo graph 1 ReArtsy Получить данные с Artsy.net.dyn "1.1_ReArtsy_GetData_from_WebSite" (Dynamo 2.0.3.8810)

# group: Выбор всех существующих типоразмеров деколей в проекте
element_types = ElementTypes(index=96)
all_elements_of_type = ElementsOfType(element_type=element_types)
code_block = CodeBlock { "Имя семейства"; }
getParameterValueByName = Element.GetParameterValueByName(element=all_elements_of_type, parameterName=code_block)
code_block_2 = CodeBlock(f=getParameterValueByName) { f == "Деколь"; }
filterByBoolMask = List.FilterByBoolMask(list=all_elements_of_type, mask=code_block_2)

artistsurls_csv_file = Filename("..\R_Тест1\ReArtsy_ArtistURLs.txt")  # graph input
importCSV = Data.ImportCSV(filePath=artistsurls_csv_file)
uniqueItems = List.UniqueItems(list=importCSV)

# group: Ссылка для поиска Художника и Кодовое имя
web_api_по_художникам = StringInput("https://api.artsy.net/api/artists/")
separ = StringInput("/")
split = String.Split(str=uniqueItems, separater0=separ)
lastItem = List.LastItem(list=split@L2)
add = web_api_по_художникам + lastItem@L1  # lacing=CrossProduct
code_block_3 = CodeBlock(slug=lastItem) { slug; }

current = Document.Current()

# group: Папка для хранения данных
filePath = Document.FilePath(document=current)
directoryName = FileSystem.DirectoryName(path=filePath)
folderName = StringInput("ReArtsyData")
combinePath = FileSystem.CombinePath(path0=directoryName, path1=folderName)
directory_from_path = DirectoryObject(path=combinePath)

# group: Имя файла данных Художника
sep = StringInput("\")
code_block_4 = CodeBlock(slug=code_block_3, dir=directory_from_path, sep=sep) { fname = slug  + ".json"; dir + sep + fname; }

# group: Отбор недостающих данных
code_block_5 = CodeBlock(href=add) { href; }
code_block_6 = CodeBlock(fpath=code_block_4.out1) { fpath; }
fileExists = FileSystem.FileExists(path=code_block_6)
filterByBoolMask_2 = List.FilterByBoolMask(list=code_block_5, mask=fileExists)
filterByBoolMask_3 = List.FilterByBoolMask(list=code_block_6, mask=fileExists)

# group: Запрос токена Artsy API
url_запроса_токена = CodeBlock { "https://api.artsy.net/api/tokens/xapp_token?client_id=764d16e87b32c1ec980a&client_secret=44d1d8838e61c277b52810ba8ecd6bdb"; }
byUrl = DynaWeb.WebRequest.ByUrl(url=url_запроса_токена)
code_block_7 = CodeBlock { "POST"; }
setMethod = DynaWeb.WebRequest.SetMethod(webRequest=byUrl, method=code_block_7)
execute = DynaWeb.WebRequest.Execute(request=setMethod)
content = DynaWeb.WebResponse.Content(webResponse=execute)
deserialiseAsDictionary = DynaWeb.Helpers.DeserialiseAsDictionary(json=content)
token = CodeBlock(v=deserialiseAsDictionary.values) { v[1]; }

# group: GET с токеном
byUrl_2 = DynaWeb.WebRequest.ByUrl(url=filterByBoolMask_2.out)
code_block_8 = CodeBlock { "GET"; }
setMethod_2 = DynaWeb.WebRequest.SetMethod(webRequest=byUrl_2, method=code_block_8)
code_block_9 = CodeBlock { "X-Xapp-Token"; }
addHeader = DynaWeb.WebRequest.AddHeader(webRequest=setMethod_2, name=code_block_9, value=token)
execute_2 = DynaWeb.WebRequest.Execute(request=addHeader)
content_2 = DynaWeb.WebResponse.Content(webResponse=execute_2)

# group: Запись недостающих и формирование общего списка данных
string = JsonData.Utilities.Parse.String(jsonString=content_2)
file_from_path = FileObject(path=filterByBoolMask_3.in)
readText = FileSystem.ReadText(file=file_from_path)
string_2 = JsonData.Utilities.Parse.String(jsonString=readText)
join = List.Join(list0=string, list1=string_2)
toJsonFile = JsonData.Utilities.Write.ToJsonFile(jsonObjects=string, filepath=filterByBoolMask_3.out, lacing=Shortest)

toDictionary = JsonData.Elements.JsonObject.ToDictionary(jsonObject=join)
search_artworks_link = CodeBlock(d=toDictionary) { d["_links"]["artworks"]["href"]; d["slug"]; }
code_block_10 = CodeBlock(token=token) { token; }

# group: GET с токеном
byUrl_3 = DynaWeb.WebRequest.ByUrl(url=search_artworks_link.out0)
code_block_11 = CodeBlock { "GET"; }
setMethod_3 = DynaWeb.WebRequest.SetMethod(webRequest=byUrl_3, method=code_block_11)
code_block_12 = CodeBlock { "X-Xapp-Token"; }
addHeader_2 = DynaWeb.WebRequest.AddHeader(webRequest=setMethod_3, name=code_block_12, value=code_block_10)
execute_3 = DynaWeb.WebRequest.Execute(request=addHeader_2)
content_3 = DynaWeb.WebResponse.Content(webResponse=execute_3)

# group: Парсинг ответа по Картинам
string_3 = JsonData.Utilities.Parse.String(jsonString=content_3)
toDictionary_2 = JsonData.Elements.JsonObject.ToDictionary(jsonObject=string_3)
artworksData = CodeBlock(d=toDictionary_2) { d["_embedded"]["artworks"]; }
flatten = List.Flatten(list=artworksData)
toDictionary_3 = JsonData.Elements.JsonObject.ToDictionary(jsonObject=flatten)

code_block_13 = CodeBlock(ArtistsSlugs=code_block_3) { ArtistsSlugs; }

# group: Папка для хранения изображений
folderName_2 = StringInput("ReArtsyImages")
combinePath_2 = FileSystem.CombinePath(path0=directoryName, path1=folderName_2)
directory_from_path_2 = DirectoryObject(path=combinePath_2)

# group: Скачивание и запись недостающих изображений, создание словаря Типов изображений
code_block_14 = CodeBlock(dic=toDictionary_3) { dic["_links"]["image"]["href"]; dic["slug"]; }
sep_2 = StringInput("\")
code_block_15 = CodeBlock(slug=code_block_14.out1, dir=directory_from_path_2, sep=sep_2) { fname = slug  + ".jpg"; fpath = dir + sep + fname; slug; }
fileExists_2 = FileSystem.FileExists(path=code_block_15.fpath)
filterByBoolMask_4 = List.FilterByBoolMask(list=code_block_15.fpath, mask=fileExists_2)
new_image_files = Watch(filterByBoolMask_4.out)  # graph output
code_block_16 = CodeBlock { "{image_version}"; "large"; }
replace = String.Replace(str=code_block_14.out0, searchFor=code_block_16.out0, replaceWith=code_block_16.out1)
filterByBoolMask_5 = List.FilterByBoolMask(list=replace, mask=fileExists_2)
byUrl_4 = DynaWeb.WebRequest.ByUrl(url=filterByBoolMask_5.out)
code_block_17 = CodeBlock { "GET"; }
setMethod_4 = DynaWeb.WebRequest.SetMethod(webRequest=byUrl_4, method=code_block_17)
execute_4 = DynaWeb.WebRequest.Execute(request=setMethod_4)
rawBytes = DynaWeb.WebResponse.RawBytes(webResponse=execute_4)
writeBinaryFilesBySlug = Python(IN[0]=rawBytes, IN[1]=filterByBoolMask_4.out)
# ---------- writeBinaryFilesBySlug.python (22 lines) ----------
# Включить поддержку Python и загрузить библиотеку DesignScript
import clr
clr.AddReference('ProtoGeometry')
from Autodesk.DesignScript.Geometry import *

# Введенные в этом узле данные сохраняется в виде списка в переменных IN.
fpath = IN[1]
data = IN[0]
resp = list()
# Разместите код под этой строкой
for i in range(len(IN[1])):
	f = open(fpath[i], 'w+b')
	byte_arr = data[i]
	binary_format = bytearray(byte_arr)
	f.write(binary_format)
	f.close()
	resp.append(fpath[i])

# Назначьте вывод переменной OUT.
OUT = resp

# 2020 BIMLAB.BY Ihar Valasatau v0.1
# ----------------------------------------
join_2 = List.Join(list0=writeBinaryFilesBySlug, list1=filterByBoolMask_4.in)
load = Prorubim.Common.Revit.Elements.ImageType.Load(path=join_2)
byKeysValues = DesignScript.Builtin.Dictionary.ByKeysValues(keys=code_block_15.slug, values=load)

# group: Добавление в проект недостающих Типов Деколей
uniqueItems_2 = List.UniqueItems(list=filterByBoolMask.in)
name = Element.Name(element=uniqueItems_2)
sortByKey = List.SortByKey(list=uniqueItems_2, keys=name)
firstItem = List.FirstItem(list=sortByKey.sorted_list)
code_block_18 = CodeBlock(dic=toDictionary_3) { dic["slug"]; dic; }
contains = List.Contains(list=sortByKey.sorted_keys, item=code_block_18.out0@L1)
filterByBoolMask_6 = List.FilterByBoolMask(list=code_block_18.out0, mask=contains)
duplicate = Custom[FamilyType.Duplicate](elementType=firstItem, name=filterByBoolMask_6.out@L1)  # Duplicates a family type
code_block_19 = CodeBlock { "Маркировка типоразмера"; "URL"; "Описание"; "Комментарии к типоразмеру"; "Изготовитель"; "Изображение типоразмера"; }
filterByBoolMask_7 = List.FilterByBoolMask(list=code_block_18.dic, mask=contains)
code_block_20 = CodeBlock(d=filterByBoolMask_7.out)
# ---------- code_block_20.designscript (6 lines) ----------
d["id"];
d["_links"]["permalink"]["href"];
d["title"]+", "+d["date"]+", "+d["category"]+", "+d["medium"]+", "+d["dimensions"]["cm"]["text"];
d["_links"]["image"]["href"];
h = d["dimensions"]["cm"]["height"]*10;
w = d["dimensions"]["cm"]["width"]*10;
# ----------------------------------------
toInteger = Orchid.Core.Number.ToInteger(number=code_block_20.h)
toInteger_2 = Orchid.Core.Number.ToInteger(number=code_block_20.w)
code_block_21 = CodeBlock(h=toInteger, w=toInteger_2) { h + "x" + w; }
string_from_object = FromObject(obj=code_block_21)
setParameterByName = Element.SetParameterByName(element=duplicate, parameterName=code_block_19.out3, value=string_from_object)
setParameterByName_2 = Element.SetParameterByName(element=duplicate, parameterName=code_block_19.out2, value=code_block_20.out2)
setParameterByName_3 = Element.SetParameterByName(element=duplicate, parameterName=code_block_19.out1, value=code_block_20.out1)
setParameterByName_4 = Element.SetParameterByName(element=duplicate, parameterName=code_block_19.out0, value=code_block_20.out0)
new_decal_types = Watch(filterByBoolMask_6.out)  # graph output
code_block_22 = CodeBlock(ArtistsList=code_block_13) { ArtistsList; }
startsWith = String.StartsWith(str=filterByBoolMask_6.out, searchFor=code_block_22, lacing=CrossProduct)
code_block_23 = CodeBlock { true; }
indexOf = List.IndexOf(list=startsWith@L2, element=code_block_23)
getItemAtIndex = List.GetItemAtIndex(list=code_block_22, index=indexOf)
setParameterByName_5 = Element.SetParameterByName(element=duplicate, parameterName=code_block_19.out4, value=getItemAtIndex)
code_block_24 = CodeBlock(slug=filterByBoolMask_6.out) { slug; }
valueAtKey = DesignScript.Builtin.Dictionary.ValueAtKey(dictionary=byKeysValues, key=code_block_24)
setParameterByName_6 = Element.SetParameterByName(element=duplicate, parameterName=code_block_19.out5, value=valueAtKey)

# group: Имя файла Списка Картин
code_block_25 = CodeBlock(dic=toDictionary_3) { dic["slug"]; }
sep_3 = StringInput("\")
code_block_26 = CodeBlock(slug=code_block_25, dir=directory_from_path, sep=sep_3) { fname = slug  + ".json"; dir + sep + fname; }

# group: Отбор недостающих данных по cписку Картин
code_block_27 = CodeBlock(fpath=code_block_26.out1) { fpath; }
fileExists_3 = FileSystem.FileExists(path=code_block_27)
filterByBoolMask_8 = List.FilterByBoolMask(list=flatten, mask=fileExists_3)
filterByBoolMask_9 = List.FilterByBoolMask(list=code_block_27, mask=fileExists_3)

# group: Запись недостающих данных
toJsonFile_2 = JsonData.Utilities.Write.ToJsonFile(jsonObjects=filterByBoolMask_8.out, filepath=filterByBoolMask_9.out, lacing=Shortest)

new_artworks = Watch(toJsonFile_2)  # graph output
new_artists = Watch(toJsonFile)  # graph output
