# Dynamo graph 2 ReArtsy Обновить Модель.dyn "2_ReArtsy_RefreshData_in_Мodel" (Dynamo 2.0.3.8810)

# group: Выбор всех экземпляров Деколей в проекте
categories = Categories(index=372)
all_elements_of_category = ElementsOfCategory(Category=categories)
elementType = Element.ElementType(element=all_elements_of_category)
code_block = CodeBlock { "Имя семейства"; }
getParameterValueByName = Element.GetParameterValueByName(element=elementType, parameterName=code_block)
code_block_2 = CodeBlock(f=getParameterValueByName) { f == "Деколь"; }
filterByBoolMask = List.FilterByBoolMask(list=all_elements_of_category, mask=code_block_2)

code_block_3 = CodeBlock(el=filterByBoolMask.in) { el.Name; el; }

# group: Получение значений из Типов Картин
code_block_4 = CodeBlock { "Тип"; }
getParameterValueByName_2 = Element.GetParameterValueByName(element=filterByBoolMask.in, parameterName=code_block_4)
code_block_5 = CodeBlock { "Маркировка типоразмера"; "URL"; "Описание"; "Комментарии к типоразмеру"; "Изготовитель"; }
getParameterValueByName_3 = Element.GetParameterValueByName(element=getParameterValueByName_2, parameterName=code_block_5.out4)
getParameterValueByName_4 = Element.GetParameterValueByName(element=getParameterValueByName_2, parameterName=code_block_5.out3)
getParameterValueByName_5 = Element.GetParameterValueByName(element=getParameterValueByName_2, parameterName=code_block_5.out2)
getParameterValueByName_6 = Element.GetParameterValueByName(element=getParameterValueByName_2, parameterName=code_block_5.out1)
getParameterValueByName_7 = Element.GetParameterValueByName(element=getParameterValueByName_2, parameterName=code_block_5.out0)

current = Document.Current()

# group: Папка для хранения данных
filePath = Document.FilePath(document=current)
directoryName = FileSystem.DirectoryName(path=filePath)
data_folder_name_in_projekt = StringInput("ReArtsyData")  # "Data Folder Name in Projekt Folder"; graph input
combinePath = FileSystem.CombinePath(path0=directoryName, path1=data_folder_name_in_projekt)
directory_from_path = DirectoryObject(path=combinePath)

# group: Загрузка данных по Художникам
uniqueItems = List.UniqueItems(list=getParameterValueByName_3)
sep = StringInput("\")
code_block_6 = CodeBlock(slug=uniqueItems, dir=directory_from_path, sep=sep) { fname = slug  + ".json"; fpath = dir + sep + fname; }
file_from_path = FileObject(path=code_block_6.fpath)
readText = FileSystem.ReadText(file=file_from_path)
string = JsonData.Utilities.Parse.String(jsonString=readText)
toDictionary = JsonData.Elements.JsonObject.ToDictionary(jsonObject=string)
byKeysValues = DesignScript.Builtin.Dictionary.ByKeysValues(keys=uniqueItems, values=toDictionary)

# group: Запись параметров ReArtsy по Художнику (из словаря) в экземпляры Деколей
code_block_7 = CodeBlock(el=code_block_3.el, artist=getParameterValueByName_3, dic=byKeysValues) { el; artist; dic[artist]; }
code_block_8 = CodeBlock()
# ---------- code_block_8.designscript (9 lines) ----------
"ReArtsy_Artist_Name";
"ReArtsy_Artist_Gender";
"ReArtsy_Artist_Nationality";
"ReArtsy_Artist_Birthday";
"ReArtsy_Artist_Deathday";
"ReArtsy_Artist_Location";
"ReArtsy_Artist_Hometown";
"ReArtsy_Artist_Biography";
"ReArtsy_Artist_URL";
# ----------------------------------------
code_block_9 = CodeBlock(d=code_block_7.out2)
# ---------- code_block_9.designscript (9 lines) ----------
d["name"];
d["gender"];
d["nationality"];
d["birthday"];
d["deathday"];
d["location"];
d["hometown"];
d["biography"];
d["_links"]["permalink"]["href"];
# ----------------------------------------
setParameterByName = Element.SetParameterByName(element=code_block_7.el, parameterName=code_block_8.out0, value=code_block_9.out0)
setParameterByName_2 = Element.SetParameterByName(element=code_block_7.el, parameterName=code_block_8.out2, value=code_block_9.out2)
setParameterByName_3 = Element.SetParameterByName(element=code_block_7.el, parameterName=code_block_8.out3, value=code_block_9.out3)
setParameterByName_4 = Element.SetParameterByName(element=code_block_7.el, parameterName=code_block_8.out4, value=code_block_9.out4)
setParameterByName_5 = Element.SetParameterByName(element=code_block_7.el, parameterName=code_block_8.out5, value=code_block_9.out5)
setParameterByName_6 = Element.SetParameterByName(element=code_block_7.el, parameterName=code_block_8.out6, value=code_block_9.out6)
setParameterByName_7 = Element.SetParameterByName(element=code_block_7.el, parameterName=code_block_8.out7, value=code_block_9.out7)
setParameterByName_8 = Element.SetParameterByName(element=code_block_7.el, parameterName=code_block_8.out8, value=code_block_9.out8)
setParameterByName_9 = Element.SetParameterByName(element=code_block_7.el, parameterName=code_block_8.out1, value=code_block_9.out1)

# group: Замена невалидных значений
code_block_10 = CodeBlock { "600x700"; }
code_block_11 = CodeBlock { "null"; }
eq = _ == code_block_11  # unwired: x
replaceByCondition = Replace(item=getParameterValueByName_4, replaceWith=code_block_10, condition=eq)

# group: Парсинг размера из комментария
string_2 = StringInput("x")
split = String.Split(str=replaceByCondition, separater0=string_2)
code_block_12 = CodeBlock { 0; 1; }
getItemAtIndex = List.GetItemAtIndex(list=split@L2, index=code_block_12.out0)
toNumber = String.ToNumber(str=getItemAtIndex)
getItemAtIndex_2 = List.GetItemAtIndex(list=split@L2, index=code_block_12.out1)
toNumber_2 = String.ToNumber(str=getItemAtIndex_2)

# group: Запись системных параметров по Картине (из Типа) в экземпляры Деколей
code_block_13 = CodeBlock(element=filterByBoolMask.in) { element; }
code_block_14 = CodeBlock { "Сохранять пропорции"; "Высота"; "Ширина"; "Комментарии"; }
code_block_15 = CodeBlock(h=toNumber, w=toNumber_2, comment=getParameterValueByName_5) { h; w; comment; }
setParameterByName_10 = Element.SetParameterByName(element=code_block_13, parameterName=code_block_14.out3, value=code_block_15.comment)
code_block_16 = CodeBlock { false; }
setParameterByName_11 = Element.SetParameterByName(element=code_block_13, parameterName=code_block_14.out0, value=code_block_16)
setParameterByName_12 = Element.SetParameterByName(element=setParameterByName_11, parameterName=code_block_14.out1, value=code_block_15.h)
setParameterByName_13 = Element.SetParameterByName(element=setParameterByName_12, parameterName=code_block_14.out2, value=code_block_15.w)

activeViewFromCurrentDocument = Custom[Document.ActiveViewFromCurrentDocument]()  # Gets the active view of the current document

# group: Поиск ближайших Элементов
code_block_17 = CodeBlock { 1; }
findNeighbourElements = Prorubim.Common.Revit.Elements.Element.FindNeighbourElements(element=setParameterByName_10@L1, view=activeViewFromCurrentDocument, offset=code_block_17)

# group: Отбор семейств ReArtsy
familyName = Orchid.RevitProject.Elements.Element.FamilyName(element=findNeighbourElements@L2)
code_block_18 = CodeBlock { "ReArtsy"; }
startsWith = String.StartsWith(str=familyName, searchFor=code_block_18)
filterByBoolMask_2 = List.FilterByBoolMask(list=findNeighbourElements@L2, mask=startsWith@L2)

# group: Запись системных параметров в экземпляры семейств картин ReArtsy
code_block_19 = CodeBlock(elements=filterByBoolMask_2.in) { elements; }
code_block_20 = CodeBlock { "Высота картины"; "Ширина картины"; "Комментарии"; "ReArtsy_Artwork_URL"; }
code_block_21 = CodeBlock(h=toNumber, w=toNumber_2, el=setParameterByName_10, url=getParameterValueByName_6) { h; w; el; url; }
setParameterByName_14 = Element.SetParameterByName(element=code_block_19, parameterName=code_block_20.out0, value=code_block_21.h)
setParameterByName_15 = Element.SetParameterByName(element=code_block_19, parameterName=code_block_20.out1, value=code_block_21.w)
id = Element.Id(element=code_block_21.el)
string_from_object = FromObject(obj=id)
setParameterByName_16 = Element.SetParameterByName(element=code_block_19, parameterName=code_block_20.out2, value=string_from_object)
setParameterByName_17 = Element.SetParameterByName(element=code_block_19, parameterName=code_block_20.out3, value=code_block_21.url)

# group: Загрузка данных по Картинам
uniqueItems_2 = List.UniqueItems(list=code_block_3.out0)
sep_2 = StringInput("\")
code_block_22 = CodeBlock(slug=uniqueItems_2, dir=directory_from_path, sep=sep_2) { fname = slug  + ".json"; fpath = dir + sep + fname; }
file_from_path_2 = FileObject(path=code_block_22.fpath)
readText_2 = FileSystem.ReadText(file=file_from_path_2)
string_3 = JsonData.Utilities.Parse.String(jsonString=readText_2)
toDictionary_2 = JsonData.Elements.JsonObject.ToDictionary(jsonObject=string_3)
byKeysValues_2 = DesignScript.Builtin.Dictionary.ByKeysValues(keys=uniqueItems_2, values=toDictionary_2)

# group: Запись параметров ReArtsy по Картине (из словаря) в экземпляры Деколей
code_block_23 = CodeBlock(el=code_block_3.el, dic=byKeysValues_2) { el; dic[el.Name]; }
code_block_24 = CodeBlock()
# ---------- code_block_24.designscript (8 lines) ----------
"ReArtsy_Artwork_Title";
"ReArtsy_Artwork_Date";
"ReArtsy_Artwork_Category";
"ReArtsy_Artwork_Medium";
"ReArtsy_Artwork_Dim_cm_Height";
"ReArtsy_Artwork_Dim_cm_Width";
"ReArtsy_Artwork_URL";
"ReArtsy_Artwork_ImageURL";
# ----------------------------------------
code_block_25 = CodeBlock(d=code_block_23.out1)
# ---------- code_block_25.designscript (8 lines) ----------
d["title"];
d["date"];
d["category"];
d["medium"];
d["dimensions"]["cm"]["height"];
d["dimensions"]["cm"]["width"];
d["_links"]["permalink"]["href"];
d["_links"]["image"]["href"];
# ----------------------------------------
code_block_26 = CodeBlock { "{image_version}"; "large"; }
replace = String.Replace(str=code_block_25.out7, searchFor=code_block_26.out0, replaceWith=code_block_26.out1)
setParameterByName_18 = Element.SetParameterByName(element=code_block_23.el, parameterName=code_block_24.out7, value=replace)
setParameterByName_19 = Element.SetParameterByName(element=code_block_23.el, parameterName=code_block_24.out6, value=code_block_25.out6)
setParameterByName_20 = Element.SetParameterByName(element=code_block_23.el, parameterName=code_block_24.out3, value=code_block_25.out3)
setParameterByName_21 = Element.SetParameterByName(element=code_block_23.el, parameterName=code_block_24.out2, value=code_block_25.out2)
setParameterByName_22 = Element.SetParameterByName(element=code_block_23.el, parameterName=code_block_24.out1, value=code_block_25.out1)
setParameterByName_23 = Element.SetParameterByName(element=code_block_23.el, parameterName=code_block_24.out0, value=code_block_25.out0)

# group: Замена невалидных значений
code_block_27 = CodeBlock { 0; }
code_block_28 = CodeBlock { "null"; }
eq_2 = _ == code_block_28  # unwired: x
replaceByCondition_2 = Replace(item=code_block_25.out5, replaceWith=code_block_27, condition=eq_2)

# group (continued): Запись параметров ReArtsy по Картине (из словаря) в экземпляры Деколей
setParameterByName_24 = Element.SetParameterByName(element=code_block_23.el, parameterName=code_block_24.out5, value=replaceByCondition_2)

# group: Замена невалидных значений
code_block_29 = CodeBlock { 0; }
code_block_30 = CodeBlock { "null"; }
eq_3 = _ == code_block_30  # unwired: x
replaceByCondition_3 = Replace(item=code_block_25.out4, replaceWith=code_block_29, condition=eq_3)

# group (continued): Запись параметров ReArtsy по Картине (из словаря) в экземпляры Деколей
setParameterByName_25 = Element.SetParameterByName(element=code_block_23.el, parameterName=code_block_24.out4, value=replaceByCondition_3)

# group: Запись параметров ReArtsy по Картине (из словаря) в экземпляры Моделей рам
code_block_31 = CodeBlock(el=filterByBoolMask_2.in) { el; }
code_block_32 = CodeBlock()  # same code as code_block_24
code_block_33 = CodeBlock(d=code_block_23.out1)  # same code as code_block_25
setParameterByName_26 = Element.SetParameterByName(element=code_block_31, parameterName=code_block_32.out0, value=code_block_33.out0)
setParameterByName_27 = Element.SetParameterByName(element=code_block_31, parameterName=code_block_32.out1, value=code_block_33.out1)
setParameterByName_28 = Element.SetParameterByName(element=code_block_31, parameterName=code_block_32.out2, value=code_block_33.out2)
setParameterByName_29 = Element.SetParameterByName(element=code_block_31, parameterName=code_block_32.out3, value=code_block_33.out3)
setParameterByName_30 = Element.SetParameterByName(element=code_block_31, parameterName=code_block_32.out6, value=code_block_33.out6)
code_block_34 = CodeBlock { "{image_version}"; "large"; }
replace_2 = String.Replace(str=code_block_33.out7, searchFor=code_block_34.out0, replaceWith=code_block_34.out1)
setParameterByName_31 = Element.SetParameterByName(element=code_block_31, parameterName=code_block_32.out7, value=replace_2)

code_block_35 = CodeBlock { "null"; }

# group: Замена невалидных значений
code_block_36 = CodeBlock { 0; }
eq_4 = _ == code_block_35  # unwired: x
replaceByCondition_4 = Replace(item=code_block_33.out4, replaceWith=code_block_36, condition=eq_4)

# group (continued): Запись параметров ReArtsy по Картине (из словаря) в экземпляры Моделей рам
setParameterByName_32 = Element.SetParameterByName(element=code_block_31, parameterName=code_block_32.out4, value=replaceByCondition_4)

# group: Замена невалидных значений
code_block_37 = CodeBlock { 0; }
code_block_38 = CodeBlock { "null"; }
eq_5 = _ == code_block_38  # unwired: x
replaceByCondition_5 = Replace(item=code_block_33.out5, replaceWith=code_block_37, condition=eq_5)

# group (continued): Запись параметров ReArtsy по Картине (из словаря) в экземпляры Моделей рам
setParameterByName_33 = Element.SetParameterByName(element=code_block_31, parameterName=code_block_32.out5, value=replaceByCondition_5)

# group: Запись параметров ReArtsy по Художнику (из словаря) в экземпляры Деколей
code_block_39 = CodeBlock(el=filterByBoolMask_2.in) { el; }
code_block_40 = CodeBlock()  # same code as code_block_8
code_block_41 = CodeBlock(d=code_block_7.out2)  # same code as code_block_9
setParameterByName_34 = Element.SetParameterByName(element=code_block_39, parameterName=code_block_40.out0, value=code_block_41.out0)
setParameterByName_35 = Element.SetParameterByName(element=code_block_39, parameterName=code_block_40.out2, value=code_block_41.out2)
setParameterByName_36 = Element.SetParameterByName(element=code_block_39, parameterName=code_block_40.out3, value=code_block_41.out3)
setParameterByName_37 = Element.SetParameterByName(element=code_block_39, parameterName=code_block_40.out4, value=code_block_41.out4)
setParameterByName_38 = Element.SetParameterByName(element=code_block_39, parameterName=code_block_40.out5, value=code_block_41.out5)
setParameterByName_39 = Element.SetParameterByName(element=code_block_39, parameterName=code_block_40.out6, value=code_block_41.out6)
setParameterByName_40 = Element.SetParameterByName(element=code_block_39, parameterName=code_block_40.out7, value=code_block_41.out7)
setParameterByName_41 = Element.SetParameterByName(element=code_block_39, parameterName=code_block_40.out8, value=code_block_41.out8)
setParameterByName_42 = Element.SetParameterByName(element=code_block_39, parameterName=code_block_40.out1, value=code_block_41.out1)
